# Grasshopper definition BuildingOnCrv.gh (Grasshopper 1.0.7)

crv = Curve([<curve referenced from the Rhino model> x1143])
crv_2 = Curve([<curve referenced from the Rhino model> x554])
mesh = Mesh(<mesh referenced from the Rhino model>)
end = EndPoints(Curve=crv)  # -> Start, End
yz = YZPlane(Origin=Point(0, 0, 0))
xz = XZPlane(Origin=Point(0, 0, 0))
vec2pt = Vector2Pt(PointA=end.Start, PointB=end.End, Unitize=True)  # -> Vector, Length
Z = UnitZ(Factor=1)
pl = PlaneNormal(Origin=end.Start, ZAxis=vec2pt.Vector)
xprod = CrossProduct(VectorA=vec2pt.Vector, VectorB=Z, Unitize=False)  # -> Vector, Length
xy = XYPlane(Origin=Point(0, 0, 0))
xprod_2 = CrossProduct(VectorA=Z, VectorB=xprod.Vector, Unitize=False)  # -> Vector, Length
pl_2 = ConstructPlane(Origin=end.Start, XAxis=xprod.Vector, YAxis=xprod_2.Vector)
orient = Orient(Geometry=mesh, Source=xy, Target=pl_2)  # -> Geometry, Transform
