# Grasshopper definition ImageSubdivide_test.gh (Grasshopper 1.0.7)

mesh = Mesh(<mesh referenced from the Rhino model>)
mesh_2 = Mesh(<mesh referenced from the Rhino model>)
mesh_3 = Mesh(<mesh referenced from the Rhino model>)
mesh_4 = Mesh(<mesh referenced from the Rhino model>)
bbox = BoundingBox(Content=mesh, Plane=PlaneXY(0, 0, 0))  # -> Box, Box_2
bbox_2 = BoundingBox(Content=mesh_2, Plane=PlaneXY(0, 0, 0))  # -> Box, Box_2
bbox_3 = BoundingBox(Content=mesh_3, Plane=PlaneXY(0, 0, 0))  # -> Box, Box_2
bbox_4 = BoundingBox(Content=mesh_4, Plane=PlaneXY(0, 0, 0))  # -> Box, Box_2
box = EvaluateBox(Box=bbox.Box, UParameter=0.5, VParameter=0.5, WParameter="0")  # -> Plane, Point, Include
box_2 = EvaluateBox(Box=bbox_2.Box, UParameter=0.5, VParameter=0.5, WParameter="0")  # -> Plane, Point, Include
box_3 = EvaluateBox(Box=bbox_3.Box, UParameter=0.5, VParameter=0.5, WParameter="0")  # -> Plane, Point, Include
box_4 = EvaluateBox(Box=bbox_4.Box, UParameter=0.5, VParameter=0.5, WParameter="0")  # -> Plane, Point, Include
panel = Panel("""typeCode:
0 - cyan
1 - dark blue
2- yellow
3 - red""")
merge = Merge(Data1=box.Plane, Data2=box_4.Plane, Data3=box_3.Plane, Data4=box_2.Plane)

# ---- group: Image Sampler Divisions
path = FilePath("D:\Processing_Code\imageSpliceoverlap\imageSpliceoverlap\data\BajaC1.png")
img = ImportImage(File=path)
bbox_5 = BoundingBox(Content=img, Plane=PlaneXY(0, 0, 0))  # -> Box, Box_2
debrep = DeconstructBrep(Brep=bbox_5.Box)  # -> Faces, Edges, Vertices
dim = Dimensions(Surface=debrep.Faces)  # -> UDimension, VDimension
division = Division(A=dim.UDimension, B=dim.VDimension)

# ---- group: Color and Type Selection / Align Planes
number_slider = Slider(16, range=0..32)

# ----
division_2 = Division(A=dim.UDimension, B=number_slider)

# ---- group: Image Sampler Divisions (continued)
multiplication = Multiplication(A=division, B=division_2)
int = Integer(multiplication)
one_over_x = OneOverX(Value=int)
one_over_x_2 = OneOverX(Value=division_2)
recgrid = Rectangular(Plane=PlaneXY(0, 0, 0), SizeX=one_over_x, SizeY=one_over_x_2, ExtentX=int, ExtentY=division_2)  # -> Cells, Points
image = ImageSampler(
    recgrid.Points,
    FilePath="D:\Processing_Code\imageSpliceoverlap\imageSpliceoverlap\data\BajaC1.png",
    Filter="Colour",
    Interpolate=False,
    Umax=1,
    Umin=0,
    Vmax=1,
    Vmin=0,
    Wrap=1)
simplify = SimplifyTree(Tree=image, Front=False)

# ---- group: Color and Type Selection / Align Planes (continued)
colorclamp = GhPythonScript(inColors=simplify)  # -> out, colorTree, typeTree; inputs inColors: tree
# ---------- colorclamp: Python ----------
import rhinoscriptsyntax as rs
import ghpythonlib.treehelpers as th
import Grasshopper as gh
import math

colorList = th.tree_to_list(inColors, lambda inColors: inColors)
outColor = []
outType = []

def listToTree(nestedList):
    
    """ Convert a nested python iterable to a datatree """
    
    dt = gh.DataTree[object]()
    for i,l in enumerate(nestedList):
        dt.AddRange(l,gh.Kernel.Data.GH_Path(i))
        
    return dt

def colorDistance(col,testCol):
    r = (col[0] - testCol[0])*(col[0] - testCol[0])
    g = (col[1] - testCol[1])*(col[1] - testCol[1])
    b = (col[2] - testCol[2])*(col[2] - testCol[2])
    dis = r+g+b
    return dis
    
def colorTest(col):
    #col is the color from the input image
    type = 0
    maxDis = 99999999
    closCol = rs.CreateVector([0,0,170])
    #test color and if its closer switch
    
    #background Color
    pVal = colorDistance(col,[255,255,255])
    if pVal < maxDis:
        maxDis = pVal
        type = 0
        closCol = rs.CreateVector([255,255,255])
    
    #cyan
    pVal = colorDistance(col,[0,0,255])
    if pVal < maxDis:
        maxDis = pVal
        type = 1
        closCol = rs.CreateVector([0,0,255])
        
    #darkBlue
    pVal = colorDistance(col,[255,0,0])
    if pVal < maxDis:
        maxDis = pVal
        type = 2
        closCol = rs.CreateVector([255,0,0])
        
    #yellow
    pVal = colorDistance(col,[0,255,0])
    if pVal < maxDis:
        maxDis = pVal
        type = 3
        closCol = rs.CreateVector([0,255,0])
        
    #red
    pVal = colorDistance(col,[255,150,150])
    if pVal < maxDis:
        maxDis = pVal
        type = 4
        closCol = rs.CreateVector([255,150,150])
        
    
        
    
        
    return closCol, type
   

for i in range(len(colorList)):
    colorRow = []
    typeRow = []
    for j in range(len(colorList[0])):
        #color test now returns two values a color and a type
        val, t = colorTest(colorList[i][j])
        colorRow.append(val)
        typeRow.append(t)
    outColor.append(colorRow)
    outType.append(typeRow)
    
colorTree = listToTree(outColor)
typeTree = listToTree(outType)
# ---------- end colorclamp ----------
colorbasedgridcell = GhPythonScript(inColor=colorclamp.colorTree, inType=colorclamp.typeTree, cellSize=number_slider)  # -> out, posList, flatten(typeList); inputs inColor: tree, inType: tree
# ---------- colorbasedgridcell: Python ----------
import rhinoscriptsyntax as rs
import ghpythonlib.treehelpers as th
import math
import Grasshopper as gh
import random

#convert inColor from a tree into a 2D List
colorList = th.tree_to_list(inColor, lambda inColor: inColor)
grid = th.tree_to_list(inType, lambda inType: inType)

#global lists for output
posList = []
typeList = []



#loop through and find neighbor counts for our pts
for x in range(len(grid)):
    for y in range(len(grid[x])):
        if grid[x][y] != 0:
            #create a position vector and put in posList
            pos = rs.CreateVector([x*cellSize, y*cellSize, 0])  
            posList.append(pos)
            t = grid[x][y] - 1
            typeList.append(t)
# ---------- end colorbasedgridcell ----------
xy = XYPlane(Origin=colorbasedgridcell.posList)

# ----
scale = Scale(Geometry=mesh, Center=box.Point, Factor=number_slider)  # -> Geometry, Transform
scale_2 = Scale(Geometry=mesh_2, Center=box_2.Point, Factor=number_slider)  # -> Geometry, Transform
scale_3 = Scale(Geometry=mesh_3, Center=box_3.Point, Factor=number_slider)  # -> Geometry, Transform
scale_4 = Scale(Geometry=mesh_4, Center=box_4.Point, Factor=number_slider)  # -> Geometry, Transform
merge_2 = Merge(Data1=scale.Geometry, Data2=scale_4.Geometry, Data3=scale_3.Geometry, Data4=scale_2.Geometry)
item = ListItem(List=merge, Index=colorbasedgridcell.typeList, Wrap=True)
item_2 = ListItem(List=merge_2, Index=colorbasedgridcell.typeList, Wrap=True)
orient = Orient(Geometry=item_2, Source=item, Target=xy)  # -> Geometry, Transform
