# Grasshopper definition MeshSimplify.gh (Grasshopper 1.0.7)

mesh = Mesh(<mesh referenced from the Rhino model>)
mesh_2 = Mesh(<mesh referenced from the Rhino model>)
demesh = DeconstructMesh(Mesh=mesh)  # -> Vertices, Faces, Colours, Normals
Z = UnitZ(Factor=1)
project = ProjectPoint(Point=demesh.Vertices, Direction=Z, Geometry=mesh_2)  # -> Point, Index
conmesh = ConstructMesh(Vertices=project.Point, Faces=demesh.Faces)
