# Grasshopper definition boxTest.gh (Grasshopper 1.0.7)

mesh = Mesh(<mesh referenced from the Rhino model>)
demesh = DeconstructMesh(Mesh=mesh)  # -> Vertices, Faces, Colours, Normals
deface = DeconstructFace(Face=demesh.Faces)  # -> CornerA, CornerB, CornerC, CornerD
item = ListItem(List=demesh.Vertices, Index=deface.CornerA, Wrap=True)
item_2 = ListItem(List=demesh.Vertices, Index=deface.CornerB, Wrap=True)
item_3 = ListItem(List=demesh.Vertices, Index=deface.CornerC, Wrap=True)
item_4 = ListItem(List=demesh.Vertices, Index=deface.CornerD, Wrap=True)
item_5 = ListItem(List=demesh.Normals, Index=deface.CornerA, Wrap=True)
item_6 = ListItem(List=demesh.Normals, Index=deface.CornerB, Wrap=True)
item_7 = ListItem(List=demesh.Normals, Index=deface.CornerC, Wrap=True)
item_8 = ListItem(List=demesh.Normals, Index=deface.CornerD, Wrap=True)
number_slider = Slider(5.57, range=0..10)
amp = Amplitude(Vector=item_6, Amplitude=number_slider)
amp_2 = Amplitude(Vector=item_5, Amplitude=number_slider)
amp_3 = Amplitude(Vector=item_7, Amplitude=number_slider)
amp_4 = Amplitude(Vector=item_8, Amplitude=number_slider)
addition = Addition(A=item, B=amp_2)
addition_2 = Addition(A=item_3, B=amp_3)
addition_3 = Addition(A=item_4, B=amp_4)
addition_4 = Addition(A=item_2, B=amp)
tbox = TwistedBox(
    CornerA=item,
    CornerB=item_2,
    CornerC=item_3,
    CornerD=item_4,
    CornerE=addition,
    CornerF=addition_4,
    CornerG=addition_2,
    CornerH=addition_3)
python = GhPythonScript(inMesh=mesh)  # -> out, typeList, centerList, fnormList, alignList, v0, v1, v2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; inputs inMesh: Mesh
# ---------- python: Python ----------
__author__ = "Michael Rehm"
__version__ = "2021.03.08"

import rhinoscriptsyntax as rs

typeList = []
centerList = []
fnormList = []
alignList = []
v0 = []
v1 = []
v2 = []
v3 = []
v4 = []
v5 = []
v6 = []
v7 = []

mCnt = inMesh.Faces.Count
faceCenters = rs.MeshFaceCenters(inMesh)
norms = rs.MeshFaceNormals(inMesh)
vnorms = rs.MeshVertexNormals(inMesh)
mFVs = rs.MeshFaceVertices(inMesh)
mVerts = rs.MeshVertices(inMesh)

def singleConnect(faceInd,neighbors):
    typeList.append(len(neighbs))
    ourVerts = mFVs[faceInd]
    neighVerts = mFVs[neighbors[0]]
    startVert = 0
    for j in range(len(ourVerts)):
        if ourVerts[j] in neighVerts:
            startVert = j
            break
    if startVert == 0:
        if ourVerts[3] in neighVerts:
            startVert = 3
    vert0 = mVerts[ourVerts[startVert]]
    v0.append(vert0)
    nVert0 = vnorms[ourVerts[startVert]]
    v4.append(nVert0)
    
    startVert += 1
    if startVert > 3:
        startVert = startVert -4
    vert1 = mVerts[ourVerts[startVert]]
    v1.append(vert1)
    nVert1 = vnorms[ourVerts[startVert]]
    v5.append(nVert1)
    
    startVert += 1
    if startVert > 3:
        startVert = startVert -4
    vert2 = mVerts[ourVerts[startVert]]
    v2.append(vert2)
    nVert2 = vnorms[ourVerts[startVert]]
    v6.append(nVert2)
    
    startVert += 1
    if startVert > 3:
        startVert = startVert -4
    vert3 = mVerts[ourVerts[startVert]]
    v3.append(vert3)
    nVert3 = vnorms[ourVerts[startVert]]
    v7.append(nVert3)
    
def threeConnect(faceInd,neighbors):
    typeList.append(len(neighbs))
    ourVerts = mFVs[faceInd]
    neighVerts = []
    neighVerts.append(mFVs[neighbors[0]])
    neighVerts.append(mFVs[neighbors[1]])
    neighVerts.append(mFVs[neighbors[2]])
    
    
    startVert = 0
    for j in range(len(ourVerts)):
        connectCount = 0
        for k in range(len(neighVerts)):
            if ourVerts[j] in neighVerts[k]:
                connectCount += 1
        if connectCount == 2:
            startVert = j
            break
    if startVert == 0:
        connectCount = 0
        for k in range(len(neighVerts)):
            if ourVerts[3] in neighVerts[k]:
                connectCount += 1
        if connectCount == 2:
            startVert = 3
    vert0 = mVerts[ourVerts[startVert]]
    v0.append(vert0)
    nVert0 = vnorms[ourVerts[startVert]]
    v4.append(nVert0)
    
    startVert += 1
    if startVert > 3:
        startVert = startVert -4
    vert1 = mVerts[ourVerts[startVert]]
    v1.append(vert1)
    nVert1 = vnorms[ourVerts[startVert]]
    v5.append(nVert1)
    
    startVert += 1
    if startVert > 3:
        startVert = startVert -4
    vert2 = mVerts[ourVerts[startVert]]
    v2.append(vert2)
    nVert2 = vnorms[ourVerts[startVert]]
    v6.append(nVert2)
    
    startVert += 1
    if startVert > 3:
        startVert = startVert -4
    vert3 = mVerts[ourVerts[startVert]]
    v3.append(vert3)
    nVert3 = vnorms[ourVerts[startVert]]
    v7.append(nVert3)
    

def twoConnect(faceInd,neighbors):
    ourVerts = mFVs[faceInd]
    neighVerts = []
    neighVerts.append(mFVs[neighbors[0]])
    neighVerts.append(mFVs[neighbors[1]])    
    
    LConnect = False
    straightSwitch = False
    startVert1 = 0
    startVert2 = 0
    for j in range(len(ourVerts)):
        connectCount = 0
        for k in range(len(neighVerts)):
            if ourVerts[j] in neighVerts[k]:
                connectCount += 1
        if connectCount == 2 and not LConnect:
            startVert2 = j
            LConnect = True            
        elif connectCount == 1 and not straightSwitch:
            startVert1 = j
            straightSwitch = True
    #if LConnect we are an L
    if LConnect:
        typeList.append(5)
        startVert = startVert2
        vert0 = mVerts[ourVerts[startVert]]
        v0.append(vert0)
        nVert0 = vnorms[ourVerts[startVert]]
        v4.append(nVert0)
        
        startVert += 1
        if startVert > 3:
            startVert = startVert -4
        vert1 = mVerts[ourVerts[startVert]]
        v1.append(vert1)
        nVert1 = vnorms[ourVerts[startVert]]
        v5.append(nVert1)
        
        startVert += 1
        if startVert > 3:
            startVert = startVert -4
        vert2 = mVerts[ourVerts[startVert]]
        v2.append(vert2)
        nVert2 = vnorms[ourVerts[startVert]]
        v6.append(nVert2)
        
        startVert += 1
        if startVert > 3:
            startVert = startVert -4
        vert3 = mVerts[ourVerts[startVert]]
        v3.append(vert3)
        nVert3 = vnorms[ourVerts[startVert]]
        v7.append(nVert3)
    else:
        typeList.append(2)
        startVert = startVert1
        nextStartVert = startVert+1
        if(nextStartVert > 3):
            nextStartVert = 0
        myNeighbor = 0
        if ourVerts[startVert] in neighVerts[1]:
            myNeighbor = 1
        if not ourVerts[nextStartVert] in neighVerts[myNeighbor]:
            startVert += 1
            if startVert > 3:
                startVert = 0
        
        vert0 = mVerts[ourVerts[startVert]]
        v0.append(vert0)
        nVert0 = vnorms[ourVerts[startVert]]
        v4.append(nVert0)
        
        startVert += 1
        if startVert > 3:
            startVert = startVert -4
        vert1 = mVerts[ourVerts[startVert]]
        v1.append(vert1)
        nVert1 = vnorms[ourVerts[startVert]]
        v5.append(nVert1)
        
        startVert += 1
        if startVert > 3:
            startVert = startVert -4
        vert2 = mVerts[ourVerts[startVert]]
        v2.append(vert2)
        nVert2 = vnorms[ourVerts[startVert]]
        v6.append(nVert2)
        
        startVert += 1
        if startVert > 3:
            startVert = startVert -4
        vert3 = mVerts[ourVerts[startVert]]
        v3.append(vert3)
        nVert3 = vnorms[ourVerts[startVert]]
        v7.append(nVert3)
    
for i in range(mCnt):
    neighbs = inMesh.Faces.AdjacentFaces(i)
    print(neighbs[0])
    
    fnormList.append(norms[i])
    centerList.append(faceCenters[i])
    if len(neighbs) == 3:
        threeConnect(i,neighbs)
    elif len(neighbs) == 2:
        twoConnect(i,neighbs)
    else:
        singleConnect(i,neighbs)
# ---------- end python ----------
brep = Brep(<brep referenced from the Rhino model>)
brep_2 = Brep(<brep referenced from the Rhino model>)
crv = Curve([<curve referenced from the Rhino model> x2])
crv_2 = Curve([<curve referenced from the Rhino model> x2])
brep_3 = Brep(<brep referenced from the Rhino model>)
brep_4 = Brep(<brep referenced from the Rhino model>)
brep_5 = Brep(<brep referenced from the Rhino model>)
brep_6 = Brep(<brep referenced from the Rhino model>)
crv_3 = Curve([<curve referenced from the Rhino model> x3])
crv_4 = Curve([<curve referenced from the Rhino model> x4])
crv_5 = Curve([<curve referenced from the Rhino model> x2])
crv_6 = Curve(<curve referenced from the Rhino model>)
amp_5 = Amplitude(Vector=python.v4, Amplitude=number_slider)
amp_6 = Amplitude(Vector=python.v5, Amplitude=number_slider)
amp_7 = Amplitude(Vector=python.v6, Amplitude=number_slider)
amp_8 = Amplitude(Vector=python.v7, Amplitude=number_slider)
group = Group(Objects=crv)
bbox = BoundingBox(Content=brep, Plane=PlaneXY(0, 0, 0))  # -> Box, Box_2
group_2 = Group(Objects=crv_2)
bbox_2 = BoundingBox(Content=brep_2, Plane=PlaneXY(0, 0, 0))  # -> Box, Box_2
group_3 = Group(Objects=crv_4)
group_4 = Group(Objects=crv_3)
bbox_3 = BoundingBox(Content=brep_4, Plane=PlaneXY(0, 0, 0))  # -> Box, Box_2
group_5 = Group(Objects=crv_5)
bbox_4 = BoundingBox(Content=brep_3, Plane=PlaneXY(0, 0, 0))  # -> Box, Box_2
group_6 = Group(Objects=crv_6)
bbox_5 = BoundingBox(Content=brep_5, Plane=PlaneXY(0, 0, 0))  # -> Box, Box_2
bbox_6 = BoundingBox(Content=brep_6, Plane=PlaneXY(0, 0, 0))  # -> Box, Box_2
addition_5 = Addition(A=python.v0, B=amp_5)
addition_6 = Addition(A=python.v1, B=amp_6)
addition_7 = Addition(A=python.v2, B=amp_7)
addition_8 = Addition(A=python.v3, B=amp_8)
pl = PlaneNormal(Origin=python.centerList, ZAxis=python.fnormList)
merge = Merge(Data1=bbox_2.Box, Data2=bbox_6.Box, Data3=bbox_5.Box, Data4=bbox_4.Box, Data5=bbox_3.Box, Data6=bbox.Box)
merge_2 = Merge(Data1=group_2, Data2=group_6, Data3=group_5, Data4=group_4, Data5=group_3, Data6=group)
tbox_2 = TwistedBox(
    CornerA=python.v0,
    CornerB=python.v1,
    CornerC=python.v2,
    CornerD=python.v3,
    CornerE=addition_5,
    CornerF=addition_6,
    CornerG=addition_7,
    CornerH=addition_8)
align = AlignPlane(Plane=pl, Direction=python.alignList)  # -> Plane, Angle
item_9 = ListItem(List=merge_2, Index=python.typeList, Wrap=True)
item_10 = ListItem(List=merge, Index=python.typeList, Wrap=True)
morph = BoxMorph(Geometry=item_9, Reference=item_10, Target=tbox_2)
