# Grasshopper definition grapeMaker.gh (Grasshopper 1.0.7)

crv = Curve([<curve referenced from the Rhino model> x67])
simplify = SimplifyCurve(Curve=crv)  # -> Curve, Simplified
Z = UnitZ(Factor=Slider(-4, range=-20..20))
Z_2 = UnitZ(Factor=Slider(4, range=0..20))
move = Move(Geometry=simplify.Curve, Motion=Z)  # -> Geometry, Transform
move_2 = Move(Geometry=simplify.Curve, Motion=Z_2)  # -> Geometry, Transform
pcen = PolygonCenter(Polyline=move_2.Geometry)  # -> CenterV, CenterE, CenterA
pcen_2 = PolygonCenter(Polyline=move.Geometry)  # -> CenterV, CenterE, CenterA
xy = XYPlane(Origin=pcen.CenterV)
xy_2 = XYPlane(Origin=pcen_2.CenterV)
scale = Scale(Geometry=move_2.Geometry, Center=xy, Factor=Slider(0.794, range=0..1))  # -> Geometry, Transform
scale_2 = Scale(Geometry=move.Geometry, Center=xy_2, Factor=Slider(0.25, range=0..1))  # -> Geometry, Transform
graft = GraftTree(Tree=scale_2.Geometry, IncludeEmptyLists=True, IncludeNullItems=True)  # -> simplify(Tree)
graft_2 = GraftTree(Tree=crv, IncludeEmptyLists=True, IncludeNullItems=True)  # -> simplify(Tree)
graft_3 = GraftTree(Tree=scale.Geometry, IncludeEmptyLists=True, IncludeNullItems=True)  # -> simplify(Tree)
graft_4 = GraftTree(Tree=crv, IncludeEmptyLists=True, IncludeNullItems=True)  # -> simplify(Tree)
boundary = BoundarySurfaces(Edges=scale.Geometry)  # -> graft(Surfaces)
boundary_2 = BoundarySurfaces(Edges=scale_2.Geometry)  # -> graft(Surfaces)
entwine = Entwine(Branch00=graft_2, Branch01=graft, FlattenInputs=True)
entwine_2 = Entwine(Branch00=graft_4, Branch01=graft_3, FlattenInputs=True)
flip = FlipMatrix(Data=entwine)
flip_2 = FlipMatrix(Data=entwine_2)
panel = Panel(flip_2)
loft_opt = LoftOptions(Closed=False, Adjust=False, Rebuild=0, Refit=0, Type=2)
loft_opt_2 = LoftOptions(Closed=False, Adjust=False, Rebuild=0, Refit=0, Type=2)
loft = Loft(Curves=flip_2, Options=loft_opt)
loft_2 = Loft(Curves=flip, Options=loft_opt_2)
entwine_3 = Entwine(Branch00=boundary, Branch01=loft, Branch02=loft_2, Branch03=boundary_2, FlattenInputs=True)
flip_3 = FlipMatrix(Data=entwine_3)
panel_2 = Panel(flip_3)
join = BrepJoin(Breps=flip_3)  # -> Breps, Closed
jagged = SettingsSpeed()
mesh = MeshBrep(Brep=join.Breps, Settings=jagged)
