# Grasshopper definition growAlgo.gh (Grasshopper 1.0.7)

# ---- group: comp1
centerpoint = Point(<point referenced from the Rhino model>)
panel = Panel("0,1")
growpts = Point([<point referenced from the Rhino model> x2])
mesh = Mesh(<mesh referenced from the Rhino model>)

# ---- group: comp0
centerpoint_2 = Point(<point referenced from the Rhino model>)
panel_2 = Panel("0,1")
growpts_2 = Point([<point referenced from the Rhino model> x2])
mesh_2 = Mesh(<mesh referenced from the Rhino model>)

# ----
group = Group(Objects=growpts)
group_2 = Group(Objects=growpts_2)
entwine = Entwine(
    Branch00=[mesh_2, mesh],
    Branch01=[centerpoint_2, centerpoint],
    Branch02=[group_2, group],
    Branch03=[panel_2, panel],
    FlattenInputs=True)
mergemeshes = Merge(Data1=mesh_2, Data2=mesh)
mergecenters = Merge(Data1=centerpoint_2, Data2=centerpoint)
flip = FlipMatrix(Data=entwine)
number_slider = Slider(20, range=0..20)
pt = Point(<point referenced from the Rhino model>)
mesh_3 = Mesh(<mesh referenced from the Rhino model>)
python = GhPythonScript(
    inMesh=mesh_3,
    startPt=pt,
    startType=Slider(0, range=0..5),
    compTree=flip,
    globalScale=number_slider,
    meshThreshold=Slider(2.066, range=0..4),
    gens=Slider(10, range=0..50))  # -> out, posList, typeList; inputs inMesh: Mesh, startPt: Point3d, startType: Int32, compTree: tree, gens: Int32
# ---------- python: Python ----------
import rhinoscriptsyntax as rs
import ghpythonlib.treehelpers as th
import Rhino

cellList = []
newCells = []
curCells = []
posList = []
typeList = []

class cell:
    def __init__(self,inCenter,inPts,inPattern):
        self.center = rs.CreateVector(inCenter)
        self.growthPts = inPts
        self.pattern = inPattern
    def searchPts(self):
        for i in range(len(self.growthPts)):
            testPt = rs.VectorAdd(self.center, self.growthPts[i])
            mPt = rs.MeshClosestPoint(inMesh,testPt)
            tDis = rs.Distance(mPt[0], testPt)
            if tDis < (meshThreshold*globalScale):
                c = testPt
                posList.append(c)
                typeList.append(self.pattern[i])
                gPts = cellList[self.pattern[i]].growthPts
                gPat = cellList[self.pattern[i]].pattern
                myCell = cell(c,gPts,gPat)
                newCells.append(myCell)
                

treeList = th.tree_to_list(compTree)
for i in range(len(treeList)):
    c = rs.CreateVector(treeList[i][1])
    sp = treeList[i][2]
    pList = []
    for j in range(len(sp)):
        pt = rs.CreateVector(sp[j])
        pt = rs.VectorCreate(pt,c)
        pt = rs.VectorScale(pt,globalScale)
        pList.append(pt)
    pattern = treeList[i][3].split(',')
    print(pattern)
    patList = []
    for j in range(len(pattern)):
        pat = int(pattern[j])
        patList.append(j)
    myCell = cell(c, pList, patList)
    cellList.append(myCell)
    
startCell = cell(startPt,cellList[startType].growthPts,cellList[startType].pattern)
curCells.append(startCell)
for g in range(gens):
    newCells = []
    for c in curCells:
        c.searchPts()
    curCells = []
    for c in newCells:
        curCells.append(c)
# ---------- end python ----------
item = ListItem(List=mergecenters, Index=python.typeList, Wrap=True)
item_2 = ListItem(List=mergemeshes, Index=python.typeList, Wrap=True)
scale = Scale(Geometry=item_2, Center=item, Factor=number_slider)  # -> Geometry, Transform
vec2pt = Vector2Pt(PointA=item, PointB=python.posList, Unitize=False)  # -> Vector, Length
move = Move(Geometry=scale.Geometry, Motion=vec2pt.Vector)  # -> Geometry, Transform
